# Grasshopper definition RhinoInside_RevitMaterialDatabaseExporter.gh (Grasshopper 1.0.7)
# plug-ins: Rhino.Inside for Autodesk Revit

query_materials = QueryMaterials()
material_identity = MaterialIdentity(Material=query_materials)  # -> Name, Description, Class, Comments, Manufacturer, Model, Cost, URL, Keynote, Mark
match_text = MatchText(Text=material_identity.Name, RegEx="BVN_", Case=True)
match_text_2 = MatchText(Text=material_identity.Name, RegEx="Glass", Case=True)
gate_and = GateAnd(A=match_text, B=invert(match_text_2))
sort_text = SortText(Keys=material_identity.Name, Values=gate_and, Culture=127)  # -> Keys, Values
sort_text_2 = SortText(Keys=material_identity.Name, Values=query_materials, Culture=127)  # -> Keys, Values
dispatch = Dispatch(List=sort_text_2.Values, DispatchPattern=sort_text.Values)  # -> ListA, ListB
graft_tree = GraftTree(Tree=dispatch.ListA, IncludeEmptyLists=True, IncludeNullItems=True)  # -> simplify(Tree)
material_identity_2 = MaterialIdentity(Material=graft_tree)  # -> Name, Description, Class, Comments, Manufacturer, Model, Cost, URL, Keynote, Mark
extract_material_s_assets = ExtractMaterialsAssets(Material=graft_tree)  # -> AppearanceAsset, PhysicalAsset, ThermalAsset
analyze_appearance_asset_generic = AnalyzeAppearanceAssetGeneric(AppearanceAssetGeneric=extract_material_s_assets.AppearanceAsset)  # -> Name, Description, Keywords, Color, Image, ImageFade, Glossiness, MetallicHighlights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
panel = Panel(material_identity_2.Name)
replace_text = ReplaceText(Text=analyze_appearance_asset_generic.Color, Find=",", Replace="/", RecursiveReplace=False)
path_to_text = PathToText(data=analyze_appearance_asset_generic.Glossiness)
path_to_text_2 = PathToText(data=analyze_appearance_asset_generic.TransparencyImage)
path_to_text_3 = PathToText(data=analyze_appearance_asset_generic.Image)
path_to_text_4 = PathToText(data=analyze_appearance_asset_generic.Cutout)
path_to_text_5 = PathToText(data=analyze_appearance_asset_generic.BumpImage)
text = Text(panel)
path_mapper = PathMapper(text, source="{A}", target="{A;0}")
path_mapper_2 = PathMapper(replace_text, source="{A}", target="{A;1}")
path_mapper_3 = PathMapper(path_to_text_3, source="{A}", target="{A;2}")
path_mapper_4 = PathMapper(path_to_text, source="{A}", target="{A;3}")
path_mapper_5 = PathMapper(path_to_text_2, source="{A}", target="{A;4}")
path_mapper_6 = PathMapper(path_to_text_4, source="{A}", target="{A;5}")
path_mapper_7 = PathMapper(path_to_text_5, source="{A}", target="{A;6}")
merge = Merge(
    Data1=path_mapper,
    Data2=path_mapper_2,
    Data3=path_mapper_3,
    Data4=path_mapper_4,
    Data5=path_mapper_5,
    Data6=path_mapper_6,
    Data7=path_mapper_7)
panel_2 = Panel("""Name
Colour
DiffPath
GlossPath
TransPath
AlphaPath
BumpPath""")
trim_tree = TrimTree(Tree=merge, Depth=1)
text_join = TextJoin(Text=panel_2, Join=",")  # -> flatten(Result)
text_join_2 = TextJoin(Text=trim_tree, Join=",")  # -> flatten(Result)
insert_items = InsertItems(List=text_join_2, Item=text_join, Indices=0, Wrap=True)
panel_3 = Panel("F:\CDG\01_Templates\Rhino\Admin\RevitMaterialLibrary\CSV-Rhino-Material-Creator")
text_join_3 = TextJoin(Text=insert_items)  # -> flatten(Result)
file_write = FileWrite(content=text_join_3, file_path=panel_3, T="RevitMaterialAudit_MP.csv", activate=Toggle(True))
panel_4 = Panel(text_join_3)

# ==== cluster PathToText
data = ClusterInput()
data_2 = Data(data)
match_text = MatchText(Text=data_2, RegEx="Bitmap", Case=True)
dispatch = Dispatch(List=data_2, DispatchPattern=match_text)  # -> ListA, ListB
text_split = TextSplit(Text=dispatch.ListA, Separators="(")
list_item = ListItem(List=text_split, Index=1, Wrap=True)
text_split_2 = TextSplit(Text=list_item, Separators=")")
list_item_2 = ListItem(List=text_split_2, Index=0, Wrap=True)
text = Text(simplify(list_item_2))
text_2 = ClusterOutput(text)

# ==== cluster FileWrite
content = ClusterInput()
file_path = ClusterInput()
T = ClusterInput()
activate = ClusterInput()
content_2 = Data(content)
file_path_2 = Text(file_path)
join = TextJoin(Text=[file_path_2, T], Join="\")
vb = VBScript(path=simplify(join), lines=simplify(content_2), activate=activate)  # -> out, A
# ---------- vb: VB ----------
    If (activate = True)

      system.IO.File.WriteAllText(path, lines)
      A = "File written"
    Else
      A = "Not activated"
    End If
# ---------- end vb ----------
